# Dynamo graph TOTEM-based tool.dyn (Dynamo 2.19.3.6394)
# packages: Clockwork for Dynamo 2.x 2.6.0

file_path = Filename(".\Excel Proof of concept_masonry concrete.xlsx")
string = StringInput("Template")
code_block = CodeBlock { 0; }
string_2 = StringInput("Unique id")
categories = Categories("OST_Floors")
all_elements_of_category = ElementsOfCategory(Category=categories)

# group: Floors
# Obtain parameters
code_block_2 = CodeBlock(t1=all_elements_of_category)
# ---------- code_block_2.designscript (3 lines) ----------
parameter1 = Parameter.ParameterByName(t1, "IfcGUID");
parameter2 = Parameter.ParameterByName(t1, "Family and Type");
parameter3 = Parameter.ParameterByName(t1, "Area");
# ----------------------------------------

code_block_3 = CodeBlock(parameter1=code_block_2.parameter1, parameter2=code_block_2.parameter2, parameter3=code_block_2.parameter3) { t1 = Parameter.Value(parameter1); t2 = Parameter.Value(parameter2); t4 = Parameter.Value(parameter3); }
elementType = Element.ElementType(element=all_elements_of_category)
compoundStructureLayers = Custom[FamilyType.CompoundStructureLayers](elementType=elementType)  # package Clockwork for Dynamo 2.x; Retrieves the compound layers of any layered family type (wall types, roof types, floor types etc.)
name = Material.Name(material=compoundStructureLayers.materials)
python_script_assign_revit = Python(IN[0]=name)  # "Python Script: Assign Revit materials to material categories"; CPython3
# ---------- python_script_assign_revit.python (63 lines) ----------
# Load the Python Standard and DesignScript Libraries
import sys
import clr
clr.AddReference('ProtoGeometry')
from Autodesk.DesignScript.Geometry import *

# The inputs to this node will be stored as a list in the IN variables.
dataEnteringNode = IN[0]

input_lists = IN[0]

input_lists = [[x.casefold() for x in sublst] for sublst in input_lists]

# Place your code below this line
def categorize_string(input_string):
    keywords = {
        "hcs": "HCS",
        "clt": "CLT",
        "screed": "SCREED",
        "wood": "WOOD",
        "oak": "WOOD",
        "lumber": "WOOD",
        "plywood": "WOOD",
        "pine": "WOOD",
        "aluminium": "STEEL",
        "steel": "STEEL",
        "metal": "STEEL",
        "iron": "STEEL",
        "brick": "MASONRY",
        "masonry": "MASONRY",
        "concrete": "CONCRETE",
        "rock wool": "FLEXIBLE INSULATION",
        "glass wool": "FLEXIBLE INSULATION",
        "flexible insulation": "FLEXIBLE INSULATION",
        "rigid insulation": "RIGID INSULATION",
        "gypsum": "GYPSUM"
        # Add more keywords and categories as needed
    }


    for keyword, category in keywords.items():
        if keyword in input_string:
            return category

    # If no keyword matches, return None or a default category
    return None

def transform_strings(input_lists):
    transformed_lists = []
    for inner_list in input_lists:
        transformed_inner_list = []
        for string in inner_list:
            category = categorize_string(string)
            if category:
                transformed_inner_list.append(category)
            else:
                # Handle cases where no category matches
                transformed_inner_list.append("OTHER")  # Or any default category you prefer
        transformed_lists.append(transformed_inner_list)
    return transformed_lists

transformed_lists = transform_strings(input_lists)
OUT = transformed_lists
# ----------------------------------------
python_script_round_layer = Python(IN[0]=compoundStructureLayers.widths)  # "Python Script: Round layer thicknesses"; CPython3
# ---------- python_script_round_layer.python (20 lines) ----------
# Load the Python Standard and DesignScript Libraries
import sys
import clr
clr.AddReference('ProtoGeometry')
from Autodesk.DesignScript.Geometry import *

# The inputs to this node will be stored as a list in the IN variables.
dataEnteringNode = IN[0]

# Place your code below this line
import math

# Assuming IN[0] is a list of lists
lists_of_lists = IN[0]

# Round each element in each sublist to two decimal places
rounded_lists = [[round(elem, 2) for elem in sublist] for sublist in lists_of_lists]

# Assign your output to the OUT variable.
OUT = rounded_lists
# ----------------------------------------
python_script_join_thickness_and = Python(IN[0]=python_script_assign_revit, IN[1]=python_script_round_layer)  # "Python Script: Join thickness and material lists"; CPython3
# ---------- python_script_join_thickness_and.python (26 lines) ----------
# Load the Python Standard and DesignScript Libraries
import sys
import clr
clr.AddReference('ProtoGeometry')
from Autodesk.DesignScript.Geometry import *

# The inputs to this node will be stored as a list in the IN variables.
dataEnteringNode = IN

# Place your code below this line
words_lists = IN[0]
numbers_lists = IN[1]
           

def combine_lists(words_lists, numbers_lists):
    combined_lists = []
    for words, numbers in zip(words_lists, numbers_lists):
        combined_inner_list = []
        for word, number in zip(words, numbers):
            combined_inner_list.append(f"{word} - {number}")
        combined_lists.append(combined_inner_list)
    return combined_lists

combined_lists = combine_lists(words_lists, numbers_lists)

OUT = combined_lists
# ----------------------------------------
python_script_remove_elements = Python(IN[0]=python_script_join_thickness_and)  # "Python Script: Remove elements belonigng to category OTHER"; CPython3
# ---------- python_script_remove_elements.python (21 lines) ----------
# Load the Python Standard and DesignScript Libraries
import sys
import clr
clr.AddReference('ProtoGeometry')
from Autodesk.DesignScript.Geometry import *

# The inputs to this node will be stored as a list in the IN variables.
dataEnteringNode = IN

# Place your code below this line
input_lists = IN[0]
               
def remove_names_with_other(names_lists):
    cleaned_lists = []
    for inner_list in names_lists:
        cleaned_inner_list = [name for name in inner_list if "OTHER" not in name]
        cleaned_lists.append(cleaned_inner_list)
    return cleaned_lists

cleaned_lists = remove_names_with_other(input_lists)
OUT = cleaned_lists
# ----------------------------------------
python_script_assign_revit_2 = Python(IN[0]=python_script_remove_elements)  # "Python Script: Assign Revit material layers to TOTEM element types"; CPython3
# ---------- python_script_assign_revit_2.python (121 lines) ----------
# Load the Python Standard and DesignScript Libraries
import sys
import clr
clr.AddReference('ProtoGeometry')
from Autodesk.DesignScript.Geometry import *

# The inputs to this node will be stored as a list in the IN variables.
dataEnteringNode = IN

# Place your code below this line
input_lists = IN[0]

def transform_name(name):
    name_parts = name.split(" - ")
    category = name_parts[0]
    number = float(name_parts[1])

    if category == "WOOD":
        if 0 <= number < 30:
            return "Wooden plate - Floor - 22"
        elif 30 <= number < 60:
            return "Wooden plate - Floor - 50"
        elif 200 <= number < 250:
            return "Wooden beams - Floor - 225" 
    elif category == "STEEL":
        if 0 <= number < 10:
            return "Steel plate - Floor - 1"
        elif 250 <= number < 360:
            return "Steel beams - Floor - 300"
    elif category == "CONCRETE":
        if 40 <= number < 60:
            return "Concrete - Floor - 50" 
        elif 140 <= number < 165:
            return "Concrete - Floor - 150"   
        elif 165 <= number < 190:
            return "Concrete - Floor - 180" 
        elif 190 <= number < 210:
            return "Concrete - Floor - 200"   
        elif 210 <= number < 235:
            return "Concrete - Floor - 220"
        elif 235 <= number < 275:
            return "Concrete - Floor - 250"
        elif 275 <= number < 325:
            return "Concrete - Floor - 300"
        elif 325 <= number < 375:
            return "Concrete - Floor - 350"
    elif category == "RIGID INSULATION":
        if 20 <= number < 40:
            return "Rigid insulation - Floor - 30"
        elif 40 <= number < 60:
            return "Rigid insulation - Floor - 50"
        elif 100 <= number < 140:
            return "Rigid insulation - Floor - 120"            
    elif category == "FLEXIBLE INSULATION":
        if 20 <= number < 40:
            return "Flexible insulation - Floor - 30"        
    elif category == "SCREED":
        if 40 <= number < 60:
            return "Screed - Floor - 50"
    elif category == "HCS":
        if 100 <= number < 135:
            return "HCS - Floor - 120"
        elif 135 <= number < 158:
            return "HCS - Floor - 150"
        elif 158 <= number < 183:
            return "HCS - Floor - 165"
        elif 183 <= number < 233:
            return "HCS - Floor - 200"
        elif 233 <= number < 300:
            return "HCS - Floor - 265"
    elif category == "CLT":
        if 50 <= number < 70:
            return "CLT - Floor - 60"
        elif 70 <= number < 90:
            return "CLT - Floor - 80"
        elif 90 <= number < 110:
            return "CLT - Floor - 100"
        elif 110 <= number < 130:
            return "CLT - Floor - 120"
        elif 130 <= number < 150:
            return "CLT - Floor - 140"
        elif 150 <= number < 170:
            return "CLT - Floor - 160"
        elif 170 <= number < 190:
            return "CLT - Floor - 180"
        elif 190 <= number < 210:
            return "CLT - Floor - 200"
        elif 210 <= number < 230:
            return "CLT - Floor - 220"
        elif 230 <= number < 250:
            return "CLT - Floor - 240"
        elif 250 <= number < 270:
            return "CLT - Floor - 260"
        elif 270 <= number < 290:
            return "CLT - Floor - 280"
        elif 290 <= number < 310:
            return "CLT - Floor - 300"
        elif 310 <= number < 330:
            return "CLT - Floor - 320"
    elif category == "GYPSUM":
        if 10 <= number < 15:
            return "Gypsum - Floor - 12"
        # Add more range checks and transformations as needed

    # If the category or number range doesn't match, return the original name
    return name

def transform_names_in_list_of_lists(names_lists):
    transformed_lists = []
    for inner_list in names_lists:
        transformed_names = []
        for name in inner_list:
            transformed_names.append(transform_name(name))
        transformed_lists.append(transformed_names)
    return transformed_lists

# Example usage:
transformed_lists = transform_names_in_list_of_lists(input_lists)

# Assign your output to the OUT variable.
OUT = transformed_lists
# ----------------------------------------
python_script_length_of_list = Python(IN[0]=python_script_assign_revit_2)  # CPython3
# ---------- python_script_length_of_list.python (20 lines) ----------
# Load the Python Standard and DesignScript Libraries
import sys
import clr
clr.AddReference('ProtoGeometry')
from Autodesk.DesignScript.Geometry import *

# The inputs to this node will be stored as a list in the IN variables.
dataEnteringNode = IN

# Place your code below this line
list_of_lists = IN[0]

def get_inner_list_lengths(list_of_lists):
    lengths = [len(inner_list) for inner_list in list_of_lists]
    return lengths

# Example usage:
lengths = get_inner_list_lengths(list_of_lists)
# Assign your output to the OUT variable.
OUT = lengths
# ----------------------------------------
python_script_add_letter_to = Python(IN[0]=code_block_3.t1, IN[1]=python_script_length_of_list)  # "Python Script: Add letter to UniqueID"; CPython3
# ---------- python_script_add_letter_to.python (25 lines) ----------
# Load the Python Standard and DesignScript Libraries
import sys
import clr
clr.AddReference('ProtoGeometry')
from Autodesk.DesignScript.Geometry import *

# The inputs to this node will be stored as a list in the IN variables.
dataEnteringNode = IN

# Place your code below this line
names = IN[0]
numbers = IN[1]

def alter_names(names, numbers):
    alphabet = 'abcdefghijklmnopqrstuvwxyz'
    altered_names = []
    for name, number in zip(names, numbers):
        for i in range(1, number + 1):
            altered_names.append(name + alphabet[i - 1])
    return altered_names

# Example usage:
result = alter_names(names, numbers)
# Assign your output to the OUT variable.
OUT = result
# ----------------------------------------
if_in_null = Python(IN[0]=python_script_add_letter_to)  # CPython3
# ---------- if_in_null.python (15 lines) ----------
# Load the Python Standard and DesignScript Libraries
import sys
import clr
clr.AddReference('ProtoGeometry')
from Autodesk.DesignScript.Geometry import *

# The inputs to this node will be stored as a list in the IN variables.
dataEnteringNode = IN

# Place your code below this line
# Check if the incoming list is empty
if not IN[0]:
    OUT = "No storey floor"  # Set the output to "1" if the incoming list is empty
else:
    OUT = IN[0]  # Otherwise, keep the output the same as the incoming list
# ----------------------------------------
categories_2 = Categories("OST_Walls")
all_elements_of_category_2 = ElementsOfCategory(Category=categories_2)

# group: Walls
# Obtain parameters
code_block_4 = CodeBlock(t1=all_elements_of_category_2)  # same code as code_block_2

code_block_5 = CodeBlock(parameter1=code_block_4.parameter1, parameter2=code_block_4.parameter2, parameter3=code_block_4.parameter3) { t1 = Parameter.Value(parameter1); t2 = Parameter.Value(parameter2); t4 = Parameter.Value(parameter3); }
elementType_2 = Element.ElementType(element=all_elements_of_category_2)
compoundStructureLayers_2 = Custom[FamilyType.CompoundStructureLayers](elementType=elementType_2)
name_2 = Material.Name(material=compoundStructureLayers_2.materials)
python_script_assign_revit_3 = Python(IN[0]=name_2)  # "Python Script: Assign Revit materials to material categories"; CPython3
# ---------- python_script_assign_revit_3.python (60 lines) ----------
# Load the Python Standard and DesignScript Libraries
import sys
import clr
clr.AddReference('ProtoGeometry')
from Autodesk.DesignScript.Geometry import *

# The inputs to this node will be stored as a list in the IN variables.
dataEnteringNode = IN[0]

input_lists = IN[0]

input_lists = [[x.casefold() for x in sublst] for sublst in input_lists]

# Place your code below this line
def categorize_string(input_string):
    keywords = {
        "screed": "SCREED",
        "wood": "WOOD",
        "lumber": "WOOD",
        "plywood": "WOOD",
        "pine": "WOOD",
        "aluminium": "STEEL",
        "steel": "STEEL",
        "metal": "STEEL",
        "iron": "STEEL",
        "brick": "MASONRY",
        "masonry": "MASONRY",
        "concrete": "CONCRETE",
        "rock wool": "FLEXIBLE INSULATION",
        "glass wool": "FLEXIBLE INSULATION",
        "rigid insulation": "RIGID INSULATION",
        "gypsum": "GYPSUM"
        # Add more keywords and categories as needed
    }


    for keyword, category in keywords.items():
        if keyword in input_string:
            return category

    # If no keyword matches, return None or a default category
    return None

def transform_strings(input_lists):
    transformed_lists = []
    for inner_list in input_lists:
        transformed_inner_list = []
        for string in inner_list:
            category = categorize_string(string)
            if category:
                transformed_inner_list.append(category)
            else:
                # Handle cases where no category matches
                transformed_inner_list.append("OTHER")  # Or any default category you prefer
        transformed_lists.append(transformed_inner_list)
    return transformed_lists

# Example usage:
transformed_lists = transform_strings(input_lists)
OUT = transformed_lists
# ----------------------------------------
python_script_round_layer_2 = Python(IN[0]=compoundStructureLayers_2.widths)  # "Python Script: Round layer thicknesses"; CPython3; same code as python_script_round_layer
python_script_join_thickness_and_2 = Python(IN[0]=python_script_assign_revit_3, IN[1]=python_script_round_layer_2)  # "Python Script: Join thickness and material lists"; CPython3
# ---------- python_script_join_thickness_and_2.python (28 lines) ----------
# Load the Python Standard and DesignScript Libraries
import sys
import clr
clr.AddReference('ProtoGeometry')
from Autodesk.DesignScript.Geometry import *

# The inputs to this node will be stored as a list in the IN variables.
dataEnteringNode = IN

# Place your code below this line
words_lists = IN[0]
numbers_lists = IN[1]
           

def combine_lists(words_lists, numbers_lists):
    combined_lists = []
    for words, numbers in zip(words_lists, numbers_lists):
        combined_inner_list = []
        for word, number in zip(words, numbers):
            combined_inner_list.append(f"{word} - {number}")
        combined_lists.append(combined_inner_list)
    return combined_lists

# Example usage:
combined_lists = combine_lists(words_lists, numbers_lists)

# Assign your output to the OUT variable.
OUT = combined_lists
# ----------------------------------------
python_script_remove_elements_2 = Python(IN[0]=python_script_join_thickness_and_2)  # "Python Script: Remove elements belonging to category OTHER"; CPython3
# ---------- python_script_remove_elements_2.python (23 lines) ----------
# Load the Python Standard and DesignScript Libraries
import sys
import clr
clr.AddReference('ProtoGeometry')
from Autodesk.DesignScript.Geometry import *

# The inputs to this node will be stored as a list in the IN variables.
dataEnteringNode = IN

# Place your code below this line
input_lists = IN[0]
               
def remove_names_with_other(names_lists):
    cleaned_lists = []
    for inner_list in names_lists:
        cleaned_inner_list = [name for name in inner_list if "OTHER" not in name]
        cleaned_lists.append(cleaned_inner_list)
    return cleaned_lists

# Example usage:
cleaned_lists = remove_names_with_other(input_lists)
# Assign your output to the OUT variable.
OUT = cleaned_lists
# ----------------------------------------
python_script_assign_revit_4 = Python(IN[0]=python_script_remove_elements_2)  # "Python Script: Assign Revit material layers to TOTEM element types"; CPython3
# ---------- python_script_assign_revit_4.python (60 lines) ----------
# Load the Python Standard and DesignScript Libraries
import sys
import clr
clr.AddReference('ProtoGeometry')
from Autodesk.DesignScript.Geometry import *

# The inputs to this node will be stored as a list in the IN variables.
dataEnteringNode = IN

# Place your code below this line
input_lists = IN[0]

def transform_name(name):
    name_parts = name.split(" - ")
    category = name_parts[0]
    number = float(name_parts[1])

    if category == "CONCRETE":
        if 140 <= number < 160:
            return "Concrete - Wall - 150"
        elif 160 <= number < 200:
            return "Concrete - Wall - 175"
        elif 200 <= number < 250:
            return "Concrete - Wall - 220"
        elif 250 <= number < 350:
            return "Concrete - Wall - 300"
    elif category == "MASONRY":
        if 75 <= number < 110:
            return "Masonry - Wall - 88"
        elif 175 <= number < 250:
            return "Masonry - Wall - 188"
        elif 250 <= number < 350:
            return "Masonry - Wall - 300"
    elif category == "RIGID INSULATION":
        if 60 <= number < 90:
            return "Rigid insulation - Wall - 80"
        elif 90 <= number < 110:
            return "Rigid insulation - Wall - 100"
    elif category == "GYPSUM":
        if 10 <= number < 15:
            return "Gypsum - Wall - 12"
        # Add more range checks and transformations as needed

    # If the category or number range doesn't match, return the original name
    return name

def transform_names_in_list_of_lists(names_lists):
    transformed_lists = []
    for inner_list in names_lists:
        transformed_names = []
        for name in inner_list:
            transformed_names.append(transform_name(name))
        transformed_lists.append(transformed_names)
    return transformed_lists

# Example usage:
transformed_lists = transform_names_in_list_of_lists(input_lists)

# Assign your output to the OUT variable.
OUT = transformed_lists
# ----------------------------------------
python_script_length_of_list_2 = Python(IN[0]=python_script_assign_revit_4)  # CPython3; same code as python_script_length_of_list
python_script_add_letter_to_2 = Python(IN[0]=code_block_5.t1, IN[1]=python_script_length_of_list_2)  # "Python Script: Add letter to UniqueID"; CPython3; same code as python_script_add_letter_to
if_in_null_2 = Python(IN[0]=python_script_add_letter_to_2)  # CPython3
# ---------- if_in_null_2.python (15 lines) ----------
# Load the Python Standard and DesignScript Libraries
import sys
import clr
clr.AddReference('ProtoGeometry')
from Autodesk.DesignScript.Geometry import *

# The inputs to this node will be stored as a list in the IN variables.
dataEnteringNode = IN

# Place your code below this line
# Check if the incoming list is empty
if not IN[0]:
    OUT = "No external wall"  # Set the output to "1" if the incoming list is empty
else:
    OUT = IN[0]  # Otherwise, keep the output the same as the incoming list
# ----------------------------------------
categories_3 = Categories("OST_StructuralFoundation")
all_elements_of_category_3 = ElementsOfCategory(Category=categories_3)

# group: Foundations
# Obtain parameters
code_block_6 = CodeBlock(t1=all_elements_of_category_3)  # same code as code_block_2

code_block_7 = CodeBlock(parameter1=code_block_6.parameter1, parameter2=code_block_6.parameter2, parameter3=code_block_6.parameter3) { t1 = Parameter.Value(parameter1); t2 = Parameter.Value(parameter2); t4 = Parameter.Value(parameter3); }
elementType_3 = Element.ElementType(element=all_elements_of_category_3)
compoundStructureLayers_3 = Custom[FamilyType.CompoundStructureLayers](elementType=elementType_3)
name_3 = Material.Name(material=compoundStructureLayers_3.materials)
python_script_assign_revit_5 = Python(IN[0]=name_3)  # "Python Script: Assign Revit materials to material categories"; CPython3
# ---------- python_script_assign_revit_5.python (59 lines) ----------
# Load the Python Standard and DesignScript Libraries
import sys
import clr
clr.AddReference('ProtoGeometry')
from Autodesk.DesignScript.Geometry import *

# The inputs to this node will be stored as a list in the IN variables.
dataEnteringNode = IN[0]

input_lists = IN[0]

input_lists = [[x.casefold() for x in sublst] for sublst in input_lists]

# Place your code below this line
def categorize_string(input_string):
    keywords = {
        "screed": "SCREED",
        "wood": "WOOD",
        "lumber": "WOOD",
        "plywood": "WOOD",
        "pine": "WOOD",
        "aluminium": "STEEL",
        "steel": "STEEL",
        "metal": "STEEL",
        "iron": "STEEL",
        "brick": "MASONRY",
        "masonry": "MASONRY",
        "concrete": "CONCRETE",
        "rock wool": "FLEXIBLE INSULATION",
        "glass wool": "FLEXIBLE INSULATION",
        "rigid insulation": "RIGID INSULATION"
        # Add more keywords and categories as needed
    }


    for keyword, category in keywords.items():
        if keyword in input_string:
            return category

    # If no keyword matches, return None or a default category
    return None

def transform_strings(input_lists):
    transformed_lists = []
    for inner_list in input_lists:
        transformed_inner_list = []
        for string in inner_list:
            category = categorize_string(string)
            if category:
                transformed_inner_list.append(category)
            else:
                # Handle cases where no category matches
                transformed_inner_list.append("OTHER")  # Or any default category you prefer
        transformed_lists.append(transformed_inner_list)
    return transformed_lists

# Example usage:
transformed_lists = transform_strings(input_lists)
OUT = transformed_lists
# ----------------------------------------
python_script_round_layer_3 = Python(IN[0]=compoundStructureLayers_3.widths)  # "Python Script: Round layer thicknesses"; CPython3; same code as python_script_round_layer
python_script_join_thickness_and_3 = Python(IN[0]=python_script_assign_revit_5, IN[1]=python_script_round_layer_3)  # "Python Script: Join thickness and material lists"; CPython3; same code as python_script_join_thickness_and_2
python_script_remove_elements_3 = Python(IN[0]=python_script_join_thickness_and_3)  # "Python Script: Remove elements belonging to category OTHER"; CPython3; same code as python_script_remove_elements_2
python_script_assign_revit_6 = Python(IN[0]=python_script_remove_elements_3)  # "Python Script: Assign Revit material layers to TOTEM element types"; CPython3
# ---------- python_script_assign_revit_6.python (56 lines) ----------
# Load the Python Standard and DesignScript Libraries
import sys
import clr
clr.AddReference('ProtoGeometry')
from Autodesk.DesignScript.Geometry import *

# The inputs to this node will be stored as a list in the IN variables.
dataEnteringNode = IN

# Place your code below this line
input_lists = IN[0]

def transform_name(name):
    name_parts = name.split(" - ")
    category = name_parts[0]
    number = float(name_parts[1])

    if category == "CONCRETE":
        if 140 <= number < 160:
            return "Concrete - Foundation - 150"    
        elif 160 <= number < 200:
            return "Concrete - Foundation - 175"    
        elif 200 <= number < 250:
            return "Concrete - Foundation - 220"
        elif 250 <= number < 350:
            return "Concrete - Foundation - 300"
    elif category == "RIGID INSULATION":
        if 20 <= number < 40:
            return "Rigid insulation - Foundation - 30"
        elif 40 <= number < 60:
            return "Rigid insulation - Foundation - 50"
    elif category == "FLEXIBLE INSULATION":
        if 20 <= number < 40:
            return "Flexible insulation - Foundation - 30"        
    elif category == "SCREED":
        if 40 <= number < 60:
            return "Screed - Floor - 50"
        # Add more range checks and transformations as needed

    # If the category or number range doesn't match, return the original name
    return name

def transform_names_in_list_of_lists(names_lists):
    transformed_lists = []
    for inner_list in names_lists:
        transformed_names = []
        for name in inner_list:
            transformed_names.append(transform_name(name))
        transformed_lists.append(transformed_names)
    return transformed_lists

# Example usage:
transformed_lists = transform_names_in_list_of_lists(input_lists)

# Assign your output to the OUT variable.
OUT = transformed_lists
# ----------------------------------------
python_script_length_of_list_3 = Python(IN[0]=python_script_assign_revit_6)  # CPython3; same code as python_script_length_of_list
python_script_add_letter_to_3 = Python(IN[0]=code_block_7.t1, IN[1]=python_script_length_of_list_3)  # "Python Script: Add letter to alter UniqueID"; CPython3; same code as python_script_add_letter_to
if_in_null_3 = Python(IN[0]=python_script_add_letter_to_3)  # CPython3
# ---------- if_in_null_3.python (15 lines) ----------
# Load the Python Standard and DesignScript Libraries
import sys
import clr
clr.AddReference('ProtoGeometry')
from Autodesk.DesignScript.Geometry import *

# The inputs to this node will be stored as a list in the IN variables.
dataEnteringNode = IN

# Place your code below this line
# Check if the incoming list is empty
if not IN[0]:
    OUT = "No floor on grade"  # Set the output to "1" if the incoming list is empty
else:
    OUT = IN[0]  # Otherwise, keep the output the same as the incoming list
# ----------------------------------------
categories_4 = Categories("OST_Roofs")
all_elements_of_category_4 = ElementsOfCategory(Category=categories_4)

# group: Roofs
# Obtain parameters
code_block_8 = CodeBlock(t1=all_elements_of_category_4)  # same code as code_block_2

code_block_9 = CodeBlock(parameter1=code_block_8.parameter1, parameter2=code_block_8.parameter2, parameter3=code_block_8.parameter3) { t1 = Parameter.Value(parameter1); t2 = Parameter.Value(parameter2); t4 = Parameter.Value(parameter3); }
elementType_4 = Element.ElementType(element=all_elements_of_category_4)
compoundStructureLayers_4 = Custom[FamilyType.CompoundStructureLayers](elementType=elementType_4)
name_4 = Material.Name(material=compoundStructureLayers_4.materials)
python_script_assign_revit_7 = Python(IN[0]=name_4)  # "Python Script: Assign Revit materials to material categories"; CPython3
# ---------- python_script_assign_revit_7.python (64 lines) ----------
# Load the Python Standard and DesignScript Libraries
import sys
import clr
clr.AddReference('ProtoGeometry')
from Autodesk.DesignScript.Geometry import *

# The inputs to this node will be stored as a list in the IN variables.
dataEnteringNode = IN[0]

input_lists = IN[0]

input_lists = [[x.casefold() for x in sublst] for sublst in input_lists]

# Place your code below this line
def categorize_string(input_string):
    keywords = {
        "hcs": "HCS",
        "clt": "CLT",
        "screed": "SCREED",
        "wood": "WOOD",
        "lumber": "WOOD",
        "plywood": "WOOD",
        "pine": "WOOD",
        "aluminium": "STEEL",
        "steel": "STEEL",
        "metal": "STEEL",
        "iron": "STEEL",
        "brick": "MASONRY",
        "masonry": "MASONRY",
        "concrete": "CONCRETE",
        "rock wool": "FLEXIBLE INSULATION",
        "glass wool": "FLEXIBLE INSULATION",
        "flexible insulation": "FLEXIBLE INSULATION",
        "rigid insulation": "RIGID INSULATION",
        "gypsum": "GYPSUM",
        "bitumen": "BITUMEN"
        # Add more keywords and categories as needed
    }


    for keyword, category in keywords.items():
        if keyword in input_string:
            return category

    # If no keyword matches, return None or a default category
    return None

def transform_strings(input_lists):
    transformed_lists = []
    for inner_list in input_lists:
        transformed_inner_list = []
        for string in inner_list:
            category = categorize_string(string)
            if category:
                transformed_inner_list.append(category)
            else:
                # Handle cases where no category matches
                transformed_inner_list.append("OTHER")  # Or any default category you prefer
        transformed_lists.append(transformed_inner_list)
    return transformed_lists

# Example usage:
transformed_lists = transform_strings(input_lists)
OUT = transformed_lists
# ----------------------------------------
python_script_round_layer_4 = Python(IN[0]=compoundStructureLayers_4.widths)  # "Python Script: Round layer thicknesses"; CPython3; same code as python_script_round_layer
python_script_join_thickness_and_4 = Python(IN[0]=python_script_assign_revit_7, IN[1]=python_script_round_layer_4)  # "Python Script: Join thickness and material lists"; CPython3; same code as python_script_join_thickness_and_2
python_script_remove_elements_4 = Python(IN[0]=python_script_join_thickness_and_4)  # "Python Script: Remove elements belonging to category OTHER"; CPython3; same code as python_script_remove_elements_2
python_script_assign_revit_8 = Python(IN[0]=python_script_remove_elements_4)  # "Python Script: Assign Revit material layers to TOTEM element types"; CPython3
# ---------- python_script_assign_revit_8.python (113 lines) ----------
# Load the Python Standard and DesignScript Libraries
import sys
import clr
clr.AddReference('ProtoGeometry')
from Autodesk.DesignScript.Geometry import *

# The inputs to this node will be stored as a list in the IN variables.
dataEnteringNode = IN

# Place your code below this line
input_lists = IN[0]

def transform_name(name):
    name_parts = name.split(" - ")
    category = name_parts[0]
    number = float(name_parts[1])

    if category == "WOOD":
        if 0 <= number < 30:
            return "Wooden plate - Roof - 18"
        elif 30 <= number < 60:
            return "Wooden plate - Roof - 50"
    if category == "SCREED":
        if 40 <= number < 60:
            return "Screed - Roof - 50"
    elif category == "STEEL":
        if 0 <= number < 10:
            return "Steel plate - Roof - 1"
        elif 120 <= number < 150:
            return "Steel - Roof - 140"
    elif category == "CONCRETE":
        if 40 <= number < 60:
            return "Concrete - Roof - 50"
        elif 100 <= number < 160:
            return "Concrete - Roof - 150"
        elif 165 <= number < 200:
            return "Concrete - Roof - 180" 
        elif 200 <= number < 250:
            return "Concrete - Roof - 220"  
        elif 250 <= number < 350:
            return "Concrete - Roof - 300"
    elif category == "RIGID INSULATION":
        if 40 <= number < 75:
            return "Rigid insulation - Roof - 50"
        elif 75 <= number < 125:
            return "Rigid insulation - Roof - 100"
        elif 125 <= number < 200:
            return "Rigid insulation - Roof - 150"
    elif category == "HCS":
        if 100 <= number < 135:
            return "HCS - Roof - 120"
        elif 135 <= number < 158:
            return "HCS - Roof - 150"
        elif 158 <= number < 183:
            return "HCS - Roof - 165"
        elif 183 <= number < 233:
            return "HCS - Roof - 200"
        elif 233 <= number < 300:
            return "HCS - Roof - 265"
    elif category == "CLT":
        if 50 <= number < 70:
            return "CLT - Floor - 60"
        elif 70 <= number < 90:
            return "CLT - Floor - 80"
        elif 90 <= number < 110:
            return "CLT - Floor - 100"
        elif 110 <= number < 130:
            return "CLT - Floor - 120"
        elif 130 <= number < 150:
            return "CLT - Floor - 140"
        elif 150 <= number < 170:
            return "CLT - Floor - 160"
        elif 170 <= number < 190:
            return "CLT - Floor - 180"
        elif 190 <= number < 210:
            return "CLT - Floor - 200"
        elif 210 <= number < 230:
            return "CLT - Floor - 220"
        elif 230 <= number < 250:
            return "CLT - Floor - 240"
        elif 250 <= number < 270:
            return "CLT - Floor - 260"
        elif 270 <= number < 290:
            return "CLT - Floor - 280"
        elif 290 <= number < 310:
            return "CLT - Floor - 300"
        elif 310 <= number < 330:
            return "CLT - Floor - 320"
    elif category == "GYPSUM":
        if 10 <= number < 15:
            return "Gypsum - Roof - 12"
    elif category == "BITUMEN":
        if 5 <= number < 10:
            return "Bitumen - Roof - 7"     
        # Add more range checks and transformations as needed

    # If the category or number range doesn't match, return the original name
    return name

def transform_names_in_list_of_lists(names_lists):
    transformed_lists = []
    for inner_list in names_lists:
        transformed_names = []
        for name in inner_list:
            transformed_names.append(transform_name(name))
        transformed_lists.append(transformed_names)
    return transformed_lists

# Example usage:
transformed_lists = transform_names_in_list_of_lists(input_lists)

# Assign your output to the OUT variable.
OUT = transformed_lists
# ----------------------------------------
python_script_length_of_list_4 = Python(IN[0]=python_script_assign_revit_8)  # CPython3; same code as python_script_length_of_list
python_script_add_letter_to_4 = Python(IN[0]=code_block_9.t1, IN[1]=python_script_length_of_list_4)  # "Python Script: Add letter to alter UniqueID"; CPython3; same code as python_script_add_letter_to
if_in_null_4 = Python(IN[0]=python_script_add_letter_to_4)  # CPython3
# ---------- if_in_null_4.python (15 lines) ----------
# Load the Python Standard and DesignScript Libraries
import sys
import clr
clr.AddReference('ProtoGeometry')
from Autodesk.DesignScript.Geometry import *

# The inputs to this node will be stored as a list in the IN variables.
dataEnteringNode = IN

# Place your code below this line
# Check if the incoming list is empty
if not IN[0]:
    OUT = "No flat roof"  # Set the output to "1" if the incoming list is empty
else:
    OUT = IN[0]  # Otherwise, keep the output the same as the incoming list
# ----------------------------------------
categories_5 = Categories("OST_StructuralColumns")
all_elements_of_category_5 = ElementsOfCategory(Category=categories_5)

# group: Columns
# Obtain parameters
code_block_10 = CodeBlock(t1=all_elements_of_category_5)
# ---------- code_block_10.designscript (8 lines) ----------
parameter1 = Parameter.ParameterByName(t1, "IfcGUID");
parameter2 = Parameter.ParameterByName(t1, "Family and Type");
num1 = List.Count(t1);
t2 = List.Cycle("Column", num1);
t3 = List.Cycle("0", num1);
parameter3 = Parameter.ParameterByName(t1, "Cut Length");
parameter4 = Parameter.ParameterByName(t1, "Structural Material");
parameter5 = Parameter.ParameterByName(t1, "Volume");
# ----------------------------------------

code_block_11 = CodeBlock(parameter1=code_block_10.parameter1, parameter2=code_block_10.parameter2, parameter3=code_block_10.parameter3, parameter4=code_block_10.parameter4, parameter5=code_block_10.parameter5)
# ---------- code_block_11.designscript (7 lines) ----------
t1 = Parameter.Value(parameter1);
t2 = Parameter.Value(parameter2);
t3 = Parameter.Value(parameter3);
t4 = 1000;
t5 = t3 / t4;
t6 = Parameter.Value(parameter4);
t7 = Parameter.Value(parameter5);
# ----------------------------------------
categories_6 = Categories("OST_StructuralFraming")
all_elements_of_category_6 = ElementsOfCategory(Category=categories_6)

# group: Beams
code_block_12 = CodeBlock(t1=all_elements_of_category_6)
# ---------- code_block_12.designscript (8 lines) ----------
parameter1 = Parameter.ParameterByName(t1, "IfcGUID");
parameter2 = Parameter.ParameterByName(t1, "Family and Type");
parameter3 = Parameter.ParameterByName(t1, "Cut Length");
num1 = List.Count(t1);
t2 = List.Cycle("Beam", num1);
t3 = List.Cycle("0", num1);
parameter4 = Parameter.ParameterByName(t1, "Structural Material");
parameter5 = Parameter.ParameterByName(t1, "Volume");
# ----------------------------------------

code_block_13 = CodeBlock(parameter1=code_block_12.parameter1, parameter2=code_block_12.parameter3, parameter3=code_block_12.parameter2, parameter4=code_block_12.parameter4, parameter5=code_block_12.parameter5)
# ---------- code_block_13.designscript (7 lines) ----------
t1 = Parameter.Value(parameter1);
t2 = Parameter.Value(parameter2);
t3 = 1000;
t4 = t2 / t3;
t5 = Parameter.Value(parameter3);
t6 = Parameter.Value(parameter4);
t7 = Parameter.Value(parameter5);
# ----------------------------------------
join_ID = List.Join(list0=string_2, list1=if_in_null, list2=if_in_null_2, list3=if_in_null_3, list4=if_in_null_4, list5=code_block_11.t1, list6=code_block_13.t1)  # "List.Join_ID"
string_3 = StringInput("Name of the element")
string_4 = StringInput(" - ")
concat = String.Concat(string1=string_4)  # unwired: string0, string2
string_from_object = FromObject(object=code_block_2.parameter2)
python_script_round_areas = Python(IN[0]=code_block_3.t4)  # CPython3
# ---------- python_script_round_areas.python (18 lines) ----------
# Load the Python Standard and DesignScript Libraries
import sys
import clr
clr.AddReference('ProtoGeometry')
from Autodesk.DesignScript.Geometry import *

# The inputs to this node will be stored as a list in the IN variables.
dataEnteringNode = IN[0]

# Place your code below this line
import math

lengths = IN[0]

lengths_rounded = [ round(elem, 2) for elem in lengths ]

# Assign your output to the OUT variable.
OUT = lengths_rounded
# ----------------------------------------
python_script_assign_letters = Python(IN[0]=python_script_round_areas)  # "Python Script: Assign letters according to area"; CPython3
# ---------- python_script_assign_letters.python (29 lines) ----------
# Load the Python Standard and DesignScript Libraries
import sys
import clr
clr.AddReference('ProtoGeometry')
from Autodesk.DesignScript.Geometry import *

# The inputs to this node will be stored as a list in the IN variables.
dataEnteringNode = IN[0]

from collections import defaultdict

beam_lengths = IN[0]

beam_letters = defaultdict(lambda: [])
current_letter = ord('a')

for length in beam_lengths:
    length_str = str(length)
    if length_str not in beam_letters:
        if current_letter <= ord('z'):
            beam_letters[length_str] = chr(current_letter)
        else:
            # If we've reached 'z', start assigning two-letter combinations
            beam_letters[length_str] = chr((current_letter - ord('a')) // 26 + ord('a')) + chr((current_letter - ord('a')) % 26 + ord('a'))
        current_letter += 1

assigned_letters = [beam_letters[str(length)] for length in beam_lengths]

OUT = assigned_letters
# ----------------------------------------
combine = List.Combine(combineFunction=concat, list0=string_from_object, list1=python_script_assign_letters)
python_script_lengthen_family = Python(IN[0]=combine, IN[1]=python_script_remove_elements)  # "Python Script: Lengthen Family and type list for all element layers"; CPython3
# ---------- python_script_lengthen_family.python (22 lines) ----------
# Load the Python Standard and DesignScript Libraries
import sys
import clr
clr.AddReference('ProtoGeometry')
from Autodesk.DesignScript.Geometry import *

# The inputs to this node will be stored as a list in the IN variables.
dataEnteringNode = IN

# Place your code below this line
def duplicate_names(names, values):
    result = []
    for name, sublist in zip(names, values):
        result.extend([name] * len(sublist))
    return result

# Example input
names = IN[0]
values = IN[1]

# Assign your output to the OUT variable.
OUT = duplicate_names(names, values)
# ----------------------------------------
if_in_null_5 = Python(IN[0]=python_script_lengthen_family)  # CPython3
# ---------- if_in_null_5.python (15 lines) ----------
# Load the Python Standard and DesignScript Libraries
import sys
import clr
clr.AddReference('ProtoGeometry')
from Autodesk.DesignScript.Geometry import *

# The inputs to this node will be stored as a list in the IN variables.
dataEnteringNode = IN

# Place your code below this line
# Check if the incoming list is empty
if not IN[0]:
    OUT = 0  # Set the output to "1" if the incoming list is empty
else:
    OUT = IN[0]  # Otherwise, keep the output the same as the incoming list
# ----------------------------------------
string_5 = StringInput(" - ")
concat_2 = String.Concat(string1=string_5)  # unwired: string0, string2
string_from_object_2 = FromObject(object=code_block_4.parameter2)
python_script_round_areas_2 = Python(IN[0]=code_block_5.t4)  # CPython3; same code as python_script_round_areas
python_script_assign_letters_2 = Python(IN[0]=python_script_round_areas_2)  # "Python Script: Assign letters according to area"; CPython3
# ---------- python_script_assign_letters_2.python (31 lines) ----------
# Load the Python Standard and DesignScript Libraries
import sys
import clr
clr.AddReference('ProtoGeometry')
from Autodesk.DesignScript.Geometry import *

# The inputs to this node will be stored as a list in the IN variables.
dataEnteringNode = IN[0]

# Place your code below this line
from collections import defaultdict

beam_lengths = IN[0]

beam_letters = defaultdict(lambda: [])
current_letter = ord('a')

for length in beam_lengths:
    length_str = str(length)
    if length_str not in beam_letters:
        if current_letter <= ord('z'):
            beam_letters[length_str] = chr(current_letter)
        else:
            # If we've reached 'z', start assigning two-letter combinations
            beam_letters[length_str] = chr((current_letter - ord('a')) // 26 + ord('a')) + chr((current_letter - ord('a')) % 26 + ord('a'))
        current_letter += 1

assigned_letters = [beam_letters[str(length)] for length in beam_lengths]

# Assign your output to the OUT variable.
OUT = assigned_letters
# ----------------------------------------
combine_2 = List.Combine(combineFunction=concat_2, list0=string_from_object_2, list1=python_script_assign_letters_2)
python_script_lengthen_family_2 = Python(IN[0]=combine_2, IN[1]=python_script_remove_elements_2)  # "Python Script: Lengthen Family and type lists for all element layers"; CPython3; same code as python_script_lengthen_family
if_in_null_6 = Python(IN[0]=python_script_lengthen_family_2)  # CPython3; same code as if_in_null_5
string_6 = StringInput(" - ")
concat_3 = String.Concat(string1=string_6)  # unwired: string0, string2
string_from_object_3 = FromObject(object=code_block_6.parameter2)
python_script_rounded_areas = Python(IN[0]=code_block_7.t4)  # CPython3; same code as python_script_round_areas
python_script_assign_letters_3 = Python(IN[0]=python_script_rounded_areas)  # "Python Script: Assign letters according to area"; CPython3
# ---------- python_script_assign_letters_3.python (27 lines) ----------
# Load the Python Standard and DesignScript Libraries
import sys
import clr
clr.AddReference('ProtoGeometry')
from Autodesk.DesignScript.Geometry import *

# The inputs to this node will be stored as a list in the IN variables.
dataEnteringNode = IN[0]

# Place your code below this line
from collections import defaultdict

beam_lengths = IN[0]

beam_letters = defaultdict(lambda: [])
current_letter = ord('a')

for length in beam_lengths:
    length_str = str(length)
    if length_str not in beam_letters:
        beam_letters[length_str] = chr(current_letter)
        current_letter += 1

assigned_letters = [beam_letters[str(length)] for length in beam_lengths];

# Assign your output to the OUT variable.
OUT = assigned_letters
# ----------------------------------------
combine_3 = List.Combine(combineFunction=concat_3, list0=string_from_object_3, list1=python_script_assign_letters_3)
python_script_lengthen_family_3 = Python(IN[0]=combine_3, IN[1]=python_script_remove_elements_3)  # "Python Script: Lengthen Family and type lists for all element layers"; CPython3; same code as python_script_lengthen_family
if_in_null_7 = Python(IN[0]=python_script_lengthen_family_3)  # CPython3; same code as if_in_null_5
string_7 = StringInput(" - ")
concat_4 = String.Concat(string1=string_7)  # unwired: string0, string2
string_from_object_4 = FromObject(object=code_block_8.parameter2)
python_script_rounded_areas_2 = Python(IN[0]=code_block_9.t4)  # CPython3; same code as python_script_round_areas
python_script_assign_letters_4 = Python(IN[0]=python_script_rounded_areas_2)  # "Python Script: Assign letters according to area"; CPython3; same code as python_script_assign_letters_3
combine_4 = List.Combine(combineFunction=concat_4, list0=string_from_object_4, list1=python_script_assign_letters_4)
python_script_lengthen_family_4 = Python(IN[0]=combine_4, IN[1]=python_script_remove_elements_4)  # "Python Script: Lengthen Family and type lists for all element layers"; CPython3; same code as python_script_lengthen_family
if_in_null_8 = Python(IN[0]=python_script_lengthen_family_4)  # CPython3; same code as if_in_null_5
string_8 = StringInput(" - ")
concat_5 = String.Concat(string1=string_8)  # unwired: string0, string2
string_from_object_5 = FromObject(object=code_block_10.parameter2)
python_script_round_lengths = Python(IN[0]=code_block_11.t5)  # CPython3; same code as python_script_round_areas
python_script_assign_letters_5 = Python(IN[0]=python_script_round_lengths)  # "Python Script: Assign letters according to lengths"; CPython3; same code as python_script_assign_letters_3
combine_5 = List.Combine(combineFunction=concat_5, list0=string_from_object_5, list1=python_script_assign_letters_5)
string_9 = StringInput(" - ")
concat_6 = String.Concat(string1=string_9)  # unwired: string0, string2
string_from_object_6 = FromObject(object=code_block_12.parameter2)
python_script_rounded_lengths = Python(IN[0]=code_block_13.t4)  # CPython3; same code as python_script_round_areas
python_script_assign_letters_6 = Python(IN[0]=python_script_rounded_lengths)  # "Python Script: Assign letters according to lengths"; CPython3; same code as python_script_assign_letters_3
combine_6 = List.Combine(combineFunction=concat_6, list0=string_from_object_6, list1=python_script_assign_letters_6)
join_Name = List.Join(list0=string_3, list1=if_in_null_5, list2=if_in_null_6, list3=if_in_null_7, list4=if_in_null_8, list5=combine_5, list6=combine_6)  # "List.Join_Name"
string_10 = StringInput("TOTEM element category")
string_11 = StringInput("Storey floor")
python_script_obtain_total = Python(IN[0]=python_script_length_of_list)  # "Python Script: Obtain total length of all lists"; CPython3
# ---------- python_script_obtain_total.python (18 lines) ----------
# Load the Python Standard and DesignScript Libraries
import sys
import clr
clr.AddReference('ProtoGeometry')
from Autodesk.DesignScript.Geometry import *

# The inputs to this node will be stored as a list in the IN variables.
dataEnteringNode = IN

# Place your code below this line
def sum_numbers(numbers):
    return sum(numbers)

# Example input
numbers = IN[0]

# Assign your output to the OUT variable.
OUT = sum_numbers(numbers)
# ----------------------------------------
if_in_null_9 = Python(IN[0]=python_script_obtain_total)  # CPython3
# ---------- if_in_null_9.python (15 lines) ----------
# Load the Python Standard and DesignScript Libraries
import sys
import clr
clr.AddReference('ProtoGeometry')
from Autodesk.DesignScript.Geometry import *

# The inputs to this node will be stored as a list in the IN variables.
dataEnteringNode = IN

# Place your code below this line
# Check if the incoming list is empty
if not IN[0]:
    OUT = 1  # Set the output to "1" if the incoming list is empty
else:
    OUT = IN[0]  # Otherwise, keep the output the same as the incoming list
# ----------------------------------------
cycle = List.Cycle(list=string_11, amount=if_in_null_9)
string_12 = StringInput("External wall")
python_script_obtain_total_2 = Python(IN[0]=python_script_length_of_list_2)  # "Python Script: Obtain total length of all lists"; CPython3; same code as python_script_obtain_total
if_in_null_10 = Python(IN[0]=python_script_obtain_total_2)  # CPython3; same code as if_in_null_9
cycle_2 = List.Cycle(list=string_12, amount=if_in_null_10)
string_13 = StringInput("Floor on grade")
python_script_obtain_total_3 = Python(IN[0]=python_script_length_of_list_3)  # "Python Script: Obtain total length of all lists"; CPython3; same code as python_script_obtain_total
if_in_null_11 = Python(IN[0]=python_script_obtain_total_3)  # CPython3; same code as if_in_null_9
cycle_3 = List.Cycle(list=string_13, amount=if_in_null_11)
string_14 = StringInput("Flat roof")
python_script_obtain_total_4 = Python(IN[0]=python_script_length_of_list_4)  # "Python Script: Obtain total length of all lists"; CPython3; same code as python_script_obtain_total
if_in_null_12 = Python(IN[0]=python_script_obtain_total_4)  # CPython3; same code as if_in_null_9
cycle_4 = List.Cycle(list=string_14, amount=if_in_null_12)
string_15 = StringInput("Column")
cycle_5 = List.Cycle(list=string_15, amount=code_block_10.num1)
string_16 = StringInput("Beam")
cycle_6 = List.Cycle(list=string_16, amount=code_block_12.num1)
join_Category = List.Join(list0=string_10, list1=cycle, list2=cycle_2, list3=cycle_3, list4=cycle_4, list5=cycle_5, list6=cycle_6)  # "List.Join_Category"
string_17 = StringInput("Surface")
python_script_lengthen_area_list = Python(IN[0]=code_block_3.t4, IN[1]=python_script_remove_elements)  # "Python Script: Lengthen area list for all element layers"; CPython3; same code as python_script_lengthen_family
if_in_null_13 = Python(IN[0]=python_script_lengthen_area_list)  # CPython3; same code as if_in_null_5
python_script_lengthen_area_list_2 = Python(IN[0]=code_block_5.t4, IN[1]=python_script_remove_elements_2)  # "Python Script: Lengthen area list for all element layers"; CPython3; same code as python_script_lengthen_family
if_in_null_14 = Python(IN[0]=python_script_lengthen_area_list_2)  # CPython3; same code as if_in_null_5
python_script_lengthen_area_list_3 = Python(IN[0]=code_block_7.t4, IN[1]=python_script_remove_elements_3)  # "Python Script: Lengthen area list for all element layers"; CPython3; same code as python_script_lengthen_family
if_in_null_15 = Python(IN[0]=python_script_lengthen_area_list_3)  # CPython3; same code as if_in_null_5
python_script_lengthen_area_list_4 = Python(IN[0]=code_block_9.t4, IN[1]=python_script_remove_elements_4)  # "Python Script: Lengthen area list for all element layers"; CPython3; same code as python_script_lengthen_family
if_in_null_16 = Python(IN[0]=python_script_lengthen_area_list_4)  # CPython3; same code as if_in_null_5
code_block_14 = CodeBlock { "0"; }
cycle_7 = List.Cycle(list=code_block_14, amount=code_block_10.num1)
code_block_15 = CodeBlock { "0"; }
cycle_8 = List.Cycle(list=code_block_15, amount=code_block_12.num1)
join_Surface = List.Join(list0=string_17, list1=if_in_null_13, list2=if_in_null_14, list3=if_in_null_15, list4=if_in_null_16, list5=cycle_7, list6=cycle_8)  # "List.Join_Surface"
string_18 = StringInput("Length")
code_block_16 = CodeBlock { "0"; }
cycle_9 = List.Cycle(list=code_block_16, amount=if_in_null_9)
code_block_17 = CodeBlock { "0"; }
cycle_10 = List.Cycle(list=code_block_17, amount=if_in_null_10)
code_block_18 = CodeBlock { "0"; }
cycle_11 = List.Cycle(list=code_block_18, amount=if_in_null_11)
code_block_19 = CodeBlock { "0"; }
cycle_12 = List.Cycle(list=code_block_19, amount=if_in_null_12)
join_Length = List.Join(list0=string_18, list1=cycle_9, list2=cycle_10, list3=cycle_11, list4=cycle_12, list5=python_script_round_lengths, list6=python_script_rounded_lengths)  # "List.Join_Length"
string_19 = StringInput("Number")
code_block_20 = CodeBlock { "1"; }
cycle_Number = List.Cycle(list=code_block_20, amount=if_in_null_9)  # "List.Cycle_Number"
code_block_21 = CodeBlock { "1"; }
cycle_Number_2 = List.Cycle(list=code_block_21, amount=if_in_null_10)  # "List.Cycle_Number"
code_block_22 = CodeBlock { "1"; }
cycle_Number_3 = List.Cycle(list=code_block_22, amount=if_in_null_11)  # "List.Cycle_Number"
code_block_23 = CodeBlock { "1"; }
cycle_Number_4 = List.Cycle(list=code_block_23, amount=if_in_null_12)  # "List.Cycle_Number"
code_block_24 = CodeBlock { "1"; }
cycle_Number_5 = List.Cycle(list=code_block_24, amount=code_block_10.num1)  # "List.Cycle_Number"
code_block_25 = CodeBlock { "1"; }
cycle_Number_6 = List.Cycle(list=code_block_25, amount=code_block_12.num1)  # "List.Cycle_Number"
join_Number = List.Join(list0=string_19, list1=cycle_Number, list2=cycle_Number_2, list3=cycle_Number_3, list4=cycle_Number_4, list5=cycle_Number_5, list6=cycle_Number_6)  # "List.Join_Number"
string_20 = StringInput("TOTEM element type name")
flatten = List.Flatten(list=python_script_assign_revit_2)
if_in_null_17 = Python(IN[0]=flatten)  # CPython3; same code as if_in_null_5
flatten_2 = List.Flatten(list=python_script_assign_revit_4)
if_in_null_18 = Python(IN[0]=flatten_2)  # CPython3; same code as if_in_null_5
flatten_3 = List.Flatten(list=python_script_assign_revit_6)
if_in_null_19 = Python(IN[0]=flatten_3)  # CPython3; same code as if_in_null_5
flatten_4 = List.Flatten(list=python_script_assign_revit_8)
if_in_null_20 = Python(IN[0]=flatten_4)  # CPython3; same code as if_in_null_5
name_5 = Material.Name(material=code_block_11.t6)
python_script_assign_revit_9 = Python(IN[0]=name_5)  # "Python Script: Assign Revit materials to material categories"; CPython3
# ---------- python_script_assign_revit_9.python (47 lines) ----------
# Load the Python Standard and DesignScript Libraries
import sys
import clr
clr.AddReference('ProtoGeometry')
from Autodesk.DesignScript.Geometry import *

# The inputs to this node will be stored as a list in the IN variables.
dataEnteringNode = IN

input_list = IN[0]

# Place your code below this line
def categorize_string(input_string):
    keywords = {
        "wood": "WOOD",
        "lumber": "WOOD",
        "plywood": "WOOD",
        "pine": "WOOD",
        "aluminium": "STEEL",
        "steel": "STEEL",
        "metal": "STEEL",
        "iron": "STEEL",
        "concrete": "CONCRETE"
        # Add more keywords and categories as needed
    }

    input_string = input_string.casefold()  # Convert input string to lowercase

    for keyword, category in keywords.items():
        if keyword in input_string:
            return category

    # If no keyword matches, return a default category
    return "OTHER"

def transform_strings(input_list):
    transformed_list = []
    for string in input_list:
        category = categorize_string(string)
        transformed_list.append(category)
    return transformed_list

# Example usage:
transformed_list = transform_strings(input_list)

# Assign your output to the OUT variable.
OUT = transformed_list
# ----------------------------------------
python_script_calculate_cross = Python(IN[0]=code_block_11.t7, IN[1]=code_block_11.t5)  # "Python Script: Calculate cross-sectional area from volume and length"; CPython3
# ---------- python_script_calculate_cross.python (34 lines) ----------
# Load the Python Standard and DesignScript Libraries
import sys
import clr
clr.AddReference('ProtoGeometry')
from Autodesk.DesignScript.Geometry import *

# The inputs to this node will be stored as a list in the IN variables.
dataEnteringNode = IN

# Place your code below this line
def divide_lists(list1, list2):
    # Check if the two input lists have the same length
    if len(list1) != len(list2):
        return "Error: Input lists must have the same length"
    
    # Initialize an empty list to store the result
    result = []
    
    # Iterate over the elements of the input lists and perform division
    for num1, num2 in zip(list1, list2):
        # Check if num2 is zero to avoid division by zero error
        if num2 == 0:
            result.append("Error: Division by zero")
        else:
            result.append(num1 / num2)
    
    return result

# Example usage:
list1 = IN[0]
list2 = IN[1]

# Assign your output to the OUT variable.
OUT = divide_lists(list1, list2)
# ----------------------------------------
python_script_round_areas_in = Python(IN[0]=python_script_calculate_cross)  # "Python Script: Round areas in list"; CPython3
# ---------- python_script_round_areas_in.python (18 lines) ----------
# Load the Python Standard and DesignScript Libraries
import sys
import clr
clr.AddReference('ProtoGeometry')
from Autodesk.DesignScript.Geometry import *

# The inputs to this node will be stored as a list in the IN variables.
dataEnteringNode = IN[0]

# Place your code below this line
import math

lengths = IN[0]

lengths_rounded = [ round(elem, 6) for elem in lengths ]

# Assign your output to the OUT variable.
OUT = lengths_rounded
# ----------------------------------------
python_script_join_length_and = Python(IN[0]=python_script_assign_revit_9, IN[1]=python_script_round_areas_in)  # "Python Script: Join length and material lists"; CPython3
# ---------- python_script_join_length_and.python (23 lines) ----------
# Load the Python Standard and DesignScript Libraries
import sys
import clr
clr.AddReference('ProtoGeometry')
from Autodesk.DesignScript.Geometry import *

# The inputs to this node will be stored as a list in the IN variables.
dataEnteringNode = IN

# Place your code below this line
def combine_lists(words_list, numbers_list):
    combined_list = []
    for word, number in zip(words_list, numbers_list):
        combined_list.append(f"{word} - {number}")
    return combined_list

# Example usage:
words_list = IN[0]
numbers_list = IN[1]
combined_list = combine_lists(words_list, numbers_list)

# Assign your output to the OUT variable.
OUT = combined_list
# ----------------------------------------
python_script_assign_revit_10 = Python(IN[0]=python_script_join_length_and)  # "Python Script: Assign Revit material layers to TOTEM element types"; CPython3
# ---------- python_script_assign_revit_10.python (69 lines) ----------
# Load the Python Standard and DesignScript Libraries
import sys
import clr
clr.AddReference('ProtoGeometry')
from Autodesk.DesignScript.Geometry import *

# The inputs to this node will be stored as a list in the IN variables.
dataEnteringNode = IN

# Place your code below this line
input_list = IN[0]

def transform_name(name):
    name_parts = name.split(" - ")
    category = name_parts[0]
    number = float(name_parts[1])

    if category == "CONCRETE":
        if 0 <= number < 0.075:
            return "Concrete - Column - 0.06"
        elif 0.075 <= number < 0.105:
            return "Concrete - Column - 0.09"
        elif 0.105 <= number < 0.14:
            return "Concrete - Column - 0.12"
        elif 0.14 <= number < 0.205:
            return "Concrete - Column - 0.16"
        elif 0.205 <= number < 0.3:
            return "Concrete - Column - 0.25"
        # Add more range checks and transformations as needed
    elif category == "STEEL":
        if 0 <= number < 0.0075:
            return "Steel - Column - 0.00156"
        elif 0.0075 <= number < 0.0175:
            return "Steel - Column - 0.01313"
        elif 0.0175 <= number < 0.026:
            return "Steel - Column - 0.02196"
        elif 0.026 <= number < 0.031:
            return "Steel - Column - 0.03031"
        elif 0.031 <= number < 0.032:
            return "Steel - Column - 0.03158"
        elif 0.032 <= number < 0.0345:
            return "Steel - Column - 0.03258"
        elif 0.0345 <= number < 0.04:
            return "Steel - Column - 0.03637"
    elif category == "WOOD":
        if 0.008 <= number < 0.0105:
            return "Wood - Column - 0.01"
        elif 0.0105 <= number < 0.0125:
            return "Wood - Column - 0.0108"
        elif 0.0125 <= number < 0.0275:
            return "Wood - Column - 0.0144"
        elif 0.0275 <= number < 0.050:
            return "Wood - Column - 0.04"
        # Add more range checks and transformations as needed

    # If the category or number range doesn't match, return the original name
    return name

def transform_names_in_list(names_list):
    transformed_names = []
    for name in names_list:
        transformed_names.append(transform_name(name))
    return transformed_names

# Example usage:
transformed_list = transform_names_in_list(input_list)

# Assign your output to the OUT variable.
OUT = transformed_list
# ----------------------------------------
name_6 = Material.Name(material=code_block_13.t6)
python_script_assign_revit_11 = Python(IN[0]=name_6)  # "Python Script: Assign Revit materials to material categories"; CPython3; same code as python_script_assign_revit_9
python_script_calculate_cross_2 = Python(IN[0]=code_block_13.t7, IN[1]=code_block_13.t4)  # "Python Script: Calculate cross-sectional area from volume and length"; CPython3; same code as python_script_calculate_cross
python_script_round_areas_in_2 = Python(IN[0]=python_script_calculate_cross_2)  # "Python Script: Round areas in list"; CPython3; same code as python_script_round_areas_in
python_script_join_length_and_2 = Python(IN[0]=python_script_assign_revit_11, IN[1]=python_script_round_areas_in_2)  # "Python Script: Join length and material lists"; CPython3; same code as python_script_join_length_and
python_script_assign_revit_12 = Python(IN[0]=python_script_join_length_and_2)  # "Python Script: Assign Revit material layers to TOTEM element types"; CPython3
# ---------- python_script_assign_revit_12.python (69 lines) ----------
# Load the Python Standard and DesignScript Libraries
import sys
import clr
clr.AddReference('ProtoGeometry')
from Autodesk.DesignScript.Geometry import *

# The inputs to this node will be stored as a list in the IN variables.
dataEnteringNode = IN

# Place your code below this line
input_list = IN[0]

def transform_name(name):
    name_parts = name.split(" - ")
    category = name_parts[0]
    number = float(name_parts[1])

    if category == "CONCRETE":
        if 0 <= number < 0.075:
            return "Concrete - Beam - 0.06"
        elif 0.075 <= number < 0.105:
            return "Concrete - Beam - 0.09"
        elif 0.105 <= number < 0.14:
            return "Concrete - Beam - 0.12"
        elif 0.14 <= number < 0.205:
            return "Concrete - Beam - 0.16"
        elif 0.205 <= number < 0.3:
            return "Concrete - Beam - 0.25"
        # Add more range checks and transformations as needed
    elif category == "STEEL":
        if 0 <= number < 0.0075:
            return "Steel - Beam - 0.00156"
        elif 0.0075 <= number < 0.0175:
            return "Steel - Beam - 0.01313"
        elif 0.0175 <= number < 0.026:
            return "Steel - Beam - 0.02196"
        elif 0.026 <= number < 0.031:
            return "Steel - Beam - 0.03031"
        elif 0.031 <= number < 0.032:
            return "Steel - Beam - 0.03158"
        elif 0.032 <= number < 0.0345:
            return "Steel - Beam - 0.03258"
        elif 0.0345 <= number < 0.04:
            return "Steel - Beam - 0.03637"
    elif category == "WOOD":
        if 0.008 <= number < 0.0105:
            return "Wood - Beam - 0.01"
        elif 0.0105 <= number < 0.0125:
            return "Wood - Beam - 0.0108"
        elif 0.0125 <= number < 0.0275:
            return "Wood - Beam - 0.0144"
        elif 0.0275 <= number < 0.050:
            return "Wood - Beam - 0.04"
        # Add more range checks and transformations as needed

    # If the category or number range doesn't match, return the original name
    return name

def transform_names_in_list(names_list):
    transformed_names = []
    for name in names_list:
        transformed_names.append(transform_name(name))
    return transformed_names

# Example usage:
transformed_list = transform_names_in_list(input_list)

# Assign your output to the OUT variable.
OUT = transformed_list
# ----------------------------------------
join_Type = List.Join(list0=string_20, list1=if_in_null_17, list2=if_in_null_18, list3=if_in_null_19, list4=if_in_null_20, list5=python_script_assign_revit_10, list6=python_script_assign_revit_12)  # "List.Join_Type"
list_create = List.Create(item0=join_ID, item1=join_Name, item2=join_Category, item3=join_Surface, item4=join_Length, item5=join_Number, item6=join_Type)
transpose = List.Transpose(lists=list_create)
code_block_26 = CodeBlock { true; }
exportToExcel = Data.ExportToExcel(filePath=file_path, sheetName=string, startRow=code_block, startColumn=code_block, data=transpose, overWrite=code_block_26)  # graph output
code_block_27 = CodeBlock { 1; }
